# Grasshopper definition unnamed.gh (Grasshopper 1.0.8)
# plug-ins: Karamba3D, Kangaroo2 Components

number_slider = Slider(10, range=0..10)
number_slider_2 = Slider(3, range=0..10)
xz = XZPlane(Origin=Point(0, 0, 0))
number_slider_3 = Slider(10, range=0..100)
rectangle = Rectangle(Plane=xz, XSize=number_slider_2, YSize=number_slider, Radius=0)  # -> Rectangle, Length
multiplication = Multiplication(A=number_slider, B=number_slider_3)
multiplication_2 = Multiplication(A=number_slider_2, B=number_slider_3)
mesh_uv = MeshSurface(Surface=rectangle.Rectangle, UCount=multiplication_2, VCount=multiplication, Overhang=True, Equalize=False)
nv = NakedVertices(Mesh=mesh_uv)  # -> ClothedIndex, NakedIndex, ClothedPts, NakedPts
pdecon = Deconstruct(Point=nv.NakedPts)  # -> XComponent, YComponent, ZComponent
surfelem = CreateSurfaceElementKaramba3D(Mesh=mesh_uv, LimitDistance_m=0.005, Bending=True, mode="MeshToShell")  # -> Element, Points, Info
smaller = SmallerThan(FirstNumber=pdecon.ZComponent, SecondNumber=0.001)  # -> SmallerThan, OrEqualTo
larger = LargerThan(FirstNumber=pdecon.ZComponent, SecondNumber=9.99)  # -> LargerThan, OrEqualTo
cull = CullPattern(List=nv.NakedPts, CullPattern=smaller.SmallerThan)
cull_2 = CullPattern(List=nv.NakedPts, CullPattern=larger.LargerThan)
rotate = Rotate(Geometry=cull_2, Angle=Slider(0.438, range=0..1), Plane=PlaneXY(0, 0, 0))  # -> Geometry, Transform
supp = SupportKaramba3D(PosInd=cull, menu=[buttons(on, on, on, off, on, on)])
vec2pt = Vector2Pt(PointA=cull_2, PointB=rotate.Geometry, Unitize=False)  # -> Vector, Length
pl = ConstructPlane(Origin=cull_2, XAxis=Vector(1, 0, 0), YAxis=vec2pt.Vector)
split = SplitList(List=pl, Index="1")  # -> ListA, ListB
xy = XYPlane(Origin=Point(0, 0, 0))
vlen = VectorLength(Vector=vec2pt.Vector)
merge = Merge(Data1=flatten(xy), Data2=flatten(split.ListB))
Y = UnitY(Factor=vlen)
predisp = PrescribedDisplacementKaramba3D(
    PositionNodeIndex=graft(cull_2),
    Plane=graft(merge),
    LoadCase=graft("LC0"),
    Translation_m=graft(Y),
    menu=[buttons(off, on, off, off, off, off)])
assemble = AssembleModelKaramba3D(Elem=surfelem.Element, Support=flatten([supp, predisp]), LimitDistance_m=0.005)  # -> Model, Info, Mass_kg, CentreOfGravity, LoadCaseNames
ladeform = LargeDeformationAnalysisKaramba3D(Model=assemble.Model, Increments=5, MaximumDisplacement_m=-1)  # -> CalculatedModel, MaximumDisplacement_cm
modelview = ModelViewKaramba3D(Model=ladeform.CalculatedModel)  # -> Model, DeformedMesh, DeformedAxes, DeformedModel, MaximumDeformation
panel = Panel("""3
-3""")
nv_2 = NakedVertices(Mesh=modelview.DeformedMesh)  # -> ClothedIndex, NakedIndex, ClothedPts, NakedPts
matprops = MaterialPropertiesKaramba3D(
    FamilyOfMaterial="Steel",
    Name="S235",
    YoungsModulus_kN_cm²="7200",
    InPlaneShearModulus_kN_cm²="2950",
    TransverseShearModulus_kN_cm²=8076,
    SpecificWeight_kN_m³="24.5",
    CoefficientOfThermalExpansion_1=1.2e-05,
    TensileStrength_kN_cm²="7",
    CompressiveStrength_kN_cm²=-23.5,
    StrengthHypothesis="MISES",
    mode="Isotrop")
panel_2 = Panel("""pression
depression""")
pdecon_2 = Deconstruct(Point=nv_2.NakedPts)  # -> XComponent, YComponent, ZComponent
Z = UnitZ(Factor=expr("-x", panel))
smaller_2 = SmallerThan(FirstNumber=pdecon_2.ZComponent, SecondNumber=0.001)  # -> SmallerThan, OrEqualTo
larger_2 = LargerThan(FirstNumber=pdecon_2.ZComponent, SecondNumber=Slider(9.95, range=0..10))  # -> LargerThan, OrEqualTo
crosec = CrossSectionKaramba3D(
    FamilyNameOfCrossSection="DefaultCroSec",
    Material=matprops,
    Height_cm=expr("x/10", Slider(50, range=0..100)),
    mode="Shell - Const")
loads = LoadsKaramba3D(
    Vector=Z,
    Mesh=modelview.DeformedMesh,
    LCase=panel_2,
    mode="MeshLoad -Const.",
    menu=[buttons(on, off, off), buttons(on, on)])
cull_3 = CullPattern(List=nv_2.NakedPts, CullPattern=smaller_2.SmallerThan)
cull_4 = CullPattern(List=nv_2.NakedPts, CullPattern=larger_2.LargerThan)
surfelem_2 = CreateSurfaceElementKaramba3D(Mesh=modelview.DeformedMesh, CrossSection=crosec, LimitDistance_m=0.005, Bending=True, mode="MeshToShell")  # -> Element, Points, Info
supp_2 = SupportKaramba3D(PosInd=cull_3, menu=[buttons(on, on, on, off, on, on)])
supp_3 = SupportKaramba3D(PosInd=cull_4, menu=[buttons(on, on, off, off, off, off)])
loads_2 = LoadsKaramba3D(Vector="{0,0,-1.35}", LCase=panel_2, mode="Gravity")
assemble_2 = AssembleModelKaramba3D(Elem=surfelem_2.Element, Support=flatten([supp_2, supp_3]), Load=flatten([loads_2, loads]), LimitDistance_m=0.005)  # -> Model, Info, Mass_kg, CentreOfGravity, LoadCaseNames
analyse = AnalyseKaramba3D(Model=assemble_2.Model)  # -> AnalysedModel, MaximumDisplacement_cm, ResultingForce_kN, ChangeOfElasticEnergy_kNm
colors = Colors()
modelview_2 = ModelViewKaramba3D(Model=analyse.AnalysedModel, Colours=colors)  # -> Model, DeformedMesh, DeformedAxes, DeformedModel, MaximumDeformation
shellview = ShellViewKaramba3D(Model=modelview_2.Model, IndexOfLayer=0)  # -> Model, MeshesOfRenderedShells, LegendColours, LegendTags
refresh_legend = Button()
md_slider = MDSlider(
    SliderMode=0,
    slider_value=Point(0.1241856319, 0.8225483313, 0.5),
    x_domain=Domain(0, 1),
    y_domain=Domain(0, 1),
    z_domain=Domain(0, 1))
arend = CSharpScript(vp=refresh_legend)  # -> Height, Width, Viewport; inputs vp: String
# ---------- arend: C# ----------
    var view = RhinoDoc.ActiveDoc.Views.Find(vp, false);
    if (view == null)
    {
      view = RhinoDoc.ActiveDoc.Views.ActiveView;
    }
    Height = view.ActiveViewport.Bounds.Height;
    Width = view.ActiveViewport.Bounds.Width;
    Viewport = view.ActiveViewport.Name;
# ---------- end arend ----------
viewport_size = Panel([arend.Width, arend.Height])
legend = Legend(C=shellview.LegendColours, L=shellview.LegendTags, i=2, S=12, viewport=viewport_size, position=md_slider)  # -> R, R_2, maximum
legend_2 = Legend(Colour=legend.R, Tags=legend.R_2, LegendType=1)

# ==== cluster Legend
C = ClusterInput()
L = ClusterInput()
i = ClusterInput()
S = ClusterInput()
viewport = ClusterInput()  # two numbers for viewport size
position = ClusterInput()  # Position of legend
lng = ListLength(List=L)
subtraction = Subtraction(A=lng, B="3")
panel = Panel("""0
-1""")
item = ListItem(List=L, Index=0, Wrap=True)
cull_i = CullIndex(List=L, Indices=panel, Wrap=True)
panel_2 = Panel(subtraction)
range = Range(Domain=Domain(0, 1), Steps=subtraction)
len = TextLength(Text=item)
lng_2 = ListLength(List=L)
split = SplitList(List=C, Index="1")  # -> ListA, ListB
gradient = Gradient(
    LowerLimit=0,
    UpperLimit=1,
    Parameter=range,
    stops=[0: RGB(0, 0, 255), 0.125: RGB(0, 128, 255), 0.25: RGB(0, 255, 255), 0.375: RGB(0, 255, 128), 0.5: RGB(0, 255, 0), 0.625: RGB(128, 255, 0), 0.75: RGB(255, 255, 0), 0.875: RGB(255, 128, 0), 1: RGB(255, 0, 0)])
subtraction_2 = Subtraction(A=len, B="13")
subtraction_3 = Subtraction(A=lng_2, B="1")
panel_3 = Panel(S)
multiplication = Multiplication(A=cull_i, B="10")
panel_4 = Panel("""defl. [mm]
stress[MPa]""")
pdecon = Deconstruct(Point=position)  # -> XComponent, YComponent, ZComponent
round = RoundNumber(number=multiplication, integer=i)
item_2 = ListItem(List=panel_4, Index=subtraction_2, Wrap=True)
merge = Merge(Data1=flatten("white"), Data2=reverse(flatten(gradient)))
subtraction_4 = Subtraction(A="1", B=pdecon.YComponent)
multiplication_2 = Multiplication(A=S, B=Slider(1.483, range=0..3))
merge_2 = Merge(Data1=pdecon.XComponent, Data2=subtraction_4)
multiplication_3 = Multiplication(A=viewport, B=merge_2)
merge_3 = Merge(Data1=item_2, Data2=reverse(round))  # -> flatten(Result)
multiplication_4 = Multiplication(A=multiplication_2, B="4")
abs = Absolute(Value=round)
pt2num = NumbersToPoints(Numbers=multiplication_3, Mask="XY")
neg = Negative(Value=multiplication_2)
sort = SortList(Keys=abs)  # -> Keys, ValuesA
panel_5 = Panel(merge)
join = TextJoin(Text=merge_3)
item_3 = ListItem(List=sort.Keys, Index="-1", Wrap=True)
recgrid = Rectangular(Plane=PlaneXY(0, 0, 0), SizeX=multiplication_4, SizeY=neg, ExtentX="1", ExtentY=subtraction_3)  # -> Cells, Points
concat = Concatenate(FragmentB=join)
R = ClusterOutput(merge)
mcol = MeshColours(Mesh=graft(recgrid.Cells), Colours=graft(merge))
number_slider = Slider(1.33, range=1..10)
fonts = FontTable()
item_4 = ListItem(List=fonts, Index=Slider(94, range=1..600), Wrap=True)
panel_6 = Panel(fonts)
panel_7 = Panel(concat)
maximum = ClusterOutput(item_3)  # maximum value
meshtoscreen = RenderMeshToScreen(Mesh=mcol, Location=pt2num, ScaleFactor=number_slider, Color=merge, Depth=0.95, Fixed=True, m_scWithvp=False)
texttoscreen = RenderTextToScreen(Text=concat, Location=pt2num, Size=S, Color=RGB(0, 0, 0), Font="calibri", m_scWithvp=False)
R_2 = ClusterOutput(merge_3)
render_mesh_to_screen = RenderMeshToScreen(Mesh=mcol, Location=pt2num, ScaleFactor=number_slider, Color=merge, Depth=0.95, Fixed=True, m_scWithvp=False)

# ==== cluster Colors
range = Range(Domain=Domain(-1, 1), Steps="16")
gradient = Gradient(
    LowerLimit=0,
    UpperLimit=1,
    Parameter=range,
    stops=[0: RGB(0, 0, 255), 0.125: RGB(0, 128, 255), 0.25: RGB(0, 255, 255), 0.375: RGB(0, 255, 128), 0.5: RGB(0, 255, 0), 0.625: RGB(128, 255, 0), 0.75: RGB(255, 255, 0), 0.875: RGB(255, 128, 0), 1: RGB(255, 0, 0)])
panel = Panel(range)
merge = Merge(Data1=flatten("255,255,255"), Data2=flatten(gradient), Data3=flatten("0,0,255"))
panel_2 = Panel(merge)
R = ClusterOutput(merge)

# ==== cluster RoundNumber: Round number
integer = ClusterInput()  # Round to 10^(-i)
number = ClusterInput()  # Number to round
int = Integer(integer)
num = Number(number)
fragment = TextFragment(Text="0000000000", Start=expr("10-x", int))
concat = Concatenate(FragmentA="format(\"{0:0.", FragmentB=fragment, FragmentC="}\",X)")
eval = Evaluate(F=concat, x=num)
r = ClusterOutput(eval)
